# Dynamo graph test pCOLLECTall1.dyn (Dynamo 0.8.1.1823)

code_block = CodeBlock { "ParameterName1"; }
code_block_2 = CodeBlock { 1; }
code_block_3 = CodeBlock { "belangrijk1"; }
code_block_4 = CodeBlock { "commentaar1"; }
code_block_5 = CodeBlock { "eigenaar"; }
code_block_6 = CodeBlock { "extra1"; }
pCOLLECT = pCOLLECT(code_block, code_block_2, code_block_3, code_block_4, code_block_5, code_block_6)
code_block_7 = CodeBlock { "ParameterName2"; }
code_block_8 = CodeBlock { 2; }
code_block_9 = CodeBlock { "belangrijk2"; }
code_block_10 = CodeBlock { "commentaar2"; }
code_block_11 = CodeBlock { "extra2"; }
pCOLLECT_2 = pCOLLECT(code_block_7, code_block_8, code_block_9, code_block_10, code_block_5, code_block_11)
create = List.Create(pCOLLECT, pCOLLECT_2)
watch = Watch(create)
code_block_12 = CodeBlock { "ParameterName1"; }
file_path = Filename("D:\Temp\test2.csv")
file_path_2 = Filename("D:\Temp\test2 - Copy.csv")
pSHARE = pSHARE(create, file_path, file_path_2, code_block_5, lacing=CrossProduct)
pPARAM = pPARAM(code_block_12, pSHARE)
watch_2 = Watch(pPARAM)
code_block_13 = CodeBlock(arg1=code_block, arg2=code_block_2, arg3=code_block_3, arg4=code_block_4, arg5=code_block_5, arg6=code_block_6) { MyDataCollector.pCOLLECTinputs(p,v,i,c,o,e); }
code_block_14 = CodeBlock(arg1=create, arg2=file_path, arg3=file_path_2, arg4=code_block_5) { MyDataCollector.pSHAREinputs(n,i,l,u); }
code_block_15 = CodeBlock(arg1=code_block_12, arg2=pSHARE) { MyDataCollector.pPARAMinputs(P,O); }
code_block_16 = CodeBlock { MyDataCollector.pCOLLECToutputs(); }
watch_3 = Watch(code_block_16)
code_block_17 = CodeBlock { "minWidth"; }
code_block_18 = CodeBlock { 5; }
code_block_19 = CodeBlock { "belangrijk5"; }
code_block_20 = CodeBlock { "commentaar5"; }
code_block_21 = CodeBlock { "extra5"; }
pCOLLECT_3 = pCOLLECT(code_block_17, code_block_18, code_block_19, code_block_20, code_block_5, code_block_21)
watch_4 = Watch(pSHARE)
