# Dynamo custom node 4 fillet centres.DYF (Dynamo 1.1.0.2065)
# category: pCOLAD
# Returns the centres of the arcs between the curves

reverse_curve_3 = Input(reverse_curve_3 : bool = false)
polyCurve = Input(polyCurve : PolyCurve)
reverse_curve_0 = Input(reverse_curve_0 : bool = false)
radius = Input(radius : double)
reverse_curve_1 = Input(reverse_curve_1 : bool = false)
reverse_curve_2 = Input(reverse_curve_2 : bool = false)

# group: Fillet centers of 4 polylines
curves = PolyCurve.Curves(polyCurve)
get4ListItems = Custom[Get4ListItems](list=curves)
reverse = Curve.Reverse(get4ListItems.item3)
if_ = If(test=reverse_curve_3, true=reverse, false=get4ListItems.item3)
reverse_2 = Curve.Reverse(get4ListItems.item0)
if_2 = If(test=reverse_curve_0, true=reverse_2, false=get4ListItems.item0)
byFillet = Arc.ByFillet(if_, if_2, radius)
centerPoint = Arc.CenterPoint(byFillet)
reverse_3 = Curve.Reverse(get4ListItems.item1)
if_3 = If(test=reverse_curve_1, true=reverse_3, false=get4ListItems.item1)
byFillet_2 = Arc.ByFillet(if_2, if_3, radius)
centerPoint_2 = Arc.CenterPoint(byFillet_2)
reverse_4 = Curve.Reverse(get4ListItems.item2)
if_4 = If(test=reverse_curve_2, true=reverse_4, false=get4ListItems.item2)
byFillet_3 = Arc.ByFillet(if_3, if_4, radius)
centerPoint_3 = Arc.CenterPoint(byFillet_3)
byFillet_4 = Arc.ByFillet(if_4, if_, radius)
centerPoint_4 = Arc.CenterPoint(byFillet_4)
create = List.Create(centerPoint, centerPoint_2, centerPoint_3, centerPoint_4)

Point = Output(centerPoint)
Point_2 = Output(centerPoint_2)  # "Point"
Point_3 = Output(centerPoint_3)  # "Point"
Point_4 = Output(centerPoint_4)  # "Point"
List = Output(create)
