# Dynamo custom node Get4ListItems.dyf (Dynamo 1.1.0.2065)
# category: pCOLAD

list = Input(list : var[]..[])
number = DoubleInput(0)
getItemAtIndex = List.GetItemAtIndex(list=list, index=number)
item = Output(getItemAtIndex)
number_2 = DoubleInput(1)
getItemAtIndex_2 = List.GetItemAtIndex(list=list, index=number_2)
item_2 = Output(getItemAtIndex_2)  # "item"
number_3 = DoubleInput(2)
getItemAtIndex_3 = List.GetItemAtIndex(list=list, index=number_3)
item_3 = Output(getItemAtIndex_3)  # "item"
number_4 = DoubleInput(3)
getItemAtIndex_4 = List.GetItemAtIndex(list=list, index=number_4)
item_4 = Output(getItemAtIndex_4)  # "item"
