# Dynamo custom node StringGHToPoints.dyf (Dynamo 1.1.0.2065)
# category: pCOLAD
# Takes string,string,string and returns Autodesk.Point

str = Input(str : string)
string = StringInput("{")
string_2 = StringInput("")
replace = String.Replace(str=str, searchFor=string, replaceWith=string_2)
string_3 = StringInput("}")
replace_2 = String.Replace(str=replace, searchFor=string_3, replaceWith=string_2)
string_4 = StringInput("/")
split = String.Split(replace_2, string_4)
code_block = CodeBlock { ","; }
split_2 = String.Split(split, code_block)
transpose = List.Transpose(split_2)
code_block_2 = CodeBlock { 0; }
getItemAtIndex = List.GetItemAtIndex(list=transpose, index=code_block_2)
toNumber = String.ToNumber(getItemAtIndex)
code_block_3 = CodeBlock { 1; }
getItemAtIndex_2 = List.GetItemAtIndex(list=transpose, index=code_block_3)
toNumber_2 = String.ToNumber(getItemAtIndex_2)
code_block_4 = CodeBlock { 2; }
getItemAtIndex_3 = List.GetItemAtIndex(list=transpose, index=code_block_4)
toNumber_3 = String.ToNumber(getItemAtIndex_3)
code_block_5 = CodeBlock(x=toNumber, y=toNumber_2, z=toNumber_3) { Autodesk.Point.ByCoordinates(x,y,z); }
Output = Output(code_block_5)  # ""
watch = Watch(getItemAtIndex_3)
flatten = Flatten(split_2)
takeEveryNthItem = List.TakeEveryNthItem(split_2)
