# Dynamo custom node StringToPoint.dyf (Dynamo 1.0.0.1180)
# category: pCOLAD
# Takes string,string,string and returns Autodesk.Point

str = Input(str : string)
code_block = CodeBlock { ","; }
split = String.Split(str, code_block)
code_block_2 = CodeBlock { 0; }
getItemAtIndex = List.GetItemAtIndex(list=split, index=code_block_2)
toNumber = String.ToNumber(getItemAtIndex)
code_block_3 = CodeBlock { 1; }
getItemAtIndex_2 = List.GetItemAtIndex(list=split, index=code_block_3)
toNumber_2 = String.ToNumber(getItemAtIndex_2)
code_block_4 = CodeBlock { 2; }
getItemAtIndex_3 = List.GetItemAtIndex(list=split, index=code_block_4)
toNumber_3 = String.ToNumber(getItemAtIndex_3)
code_block_5 = CodeBlock(x=toNumber, y=toNumber_2, z=toNumber_3) { Autodesk.Point.ByCoordinates(x,y,z); }
Output = Output(code_block_5)  # ""
