# Grasshopper definition pCAD test 4.gh (Grasshopper 0.9.56)
# plug-ins: pCOLAD1

panel = Panel("Comment;Parameter;New Value;Rejected;Old Value;Owner;Importance;Date;Author")
path = FilePath("D:\Temp\my.csv")
path_2 = FilePath("D:\Data\Dropbox\pCOLAD\ParamTest New 2.csv")
number_slider = Slider(0.34, range=0..1)
number_slider_2 = Slider(10.978, range=0..20)
panel_2 = Panel(path)
# Doubleclick Me!
on_off = BooleanToggle(False)
# Alternatively we could make a flexible cluster. Under File menu you can make it a user object.
flex_pcollect = FlexPCOLLECT(T="P3", T_2=number_slider_2, T_3="+++", T_4="This is comment 1", T_5="Hans")
flex_pcollect_2 = FlexPCOLLECT(T="P20", T_2=number_slider, T_3="+", T_4="This is comment 2", T_5="Hans")
panel_3 = Panel([flex_pcollect, flex_pcollect_2])
pcollect = PCOLLECT(P="P3", V=number_slider_2, I="+++", C="This is comment 1", O="Hans")
pcollect_2 = PCOLLECT(P="P20", V=number_slider, I="+", C="This is comment 2", O="Hans")
pshare = PSHARE(B=on_off, N=[panel, pcollect, pcollect_2], I=panel_2, L="D:\Temp\newMy.csv", U="Hans")
panel_4 = Panel([panel, pcollect, pcollect_2])
panel_5 = Panel(pshare)
pparam = PPARAM(Parameter="P3", PSHAREOutput=pshare)
panel_6 = Panel(pparam)
item = ListItem(List=panel_5, Index=Slider(5, range=1..13), Wrap=True)
line = LineSDL(Start=Point(0, 0, 0), Direction=Vector(-12.07499626, 8.608490156, 0), Length=panel_6)
panel_7 = Panel(item)
trim = TextTrim(Text=panel_7, Start=True, End=True)
line_2 = LineSDL(Start=Point(0, 0, 0), Direction=Vector(-12.07499626, 8.608490156, 0), Length=trim)

# ==== cluster FlexPCOLLECT
panel = Panel("Comment;Parameter;New Value;Rejected;Old Value;Owner;Importance;Date;Author")
# P
T = ClusterInput()
# V
T_2 = ClusterInput()
# I
T_3 = ClusterInput()
# C
T_4 = ClusterInput()
# O
T_5 = ClusterInput()
T_6 = ClusterInput()
join = TextJoin(Text=[T_4, T, T_2, "", "", T_5, T_3, ""], Join=";")
R = ClusterOutput(join)
