# Grasshopper definition test.gh (Grasshopper 0.9.76)
# plug-ins: pCOLAD1

path = FilePath("D:\Temp\test2 - Copy.csv")
path_2 = FilePath("D:\Temp\test2.csv")
panel = Panel(path)
panel_2 = Panel(path_2)
pcollect = PCOLLECT(P="Test1", V="Value1", I="Important1", C="Comment1", O="Hans")
pcollect_2 = PCOLLECT(P="Test2", V="Value2", I="Important2", C="Comment2", O="Hans")
pshare = PSHARE(B=Toggle(True), N=[pcollect, pcollect_2], I=panel_2, L=panel, U="Hans")
pparam = PPARAM(String="Test1", PSHAREOutput=pshare)
panel_3 = Panel(pshare)
panel_4 = Panel(pparam)
