# Grasshopper definition test2.gh (Grasshopper 0.9.76)
# plug-ins: pCOLAD1

path = FilePath("D:\Temp\test.csv")
path_2 = FilePath("D:\Temp\test2 - Copy.csv")
panel = Panel(path)
panel_2 = Panel(path_2)
pcollect = PCOLLECT(P="Param Grasshopper 1", V="0.1", I="-", C="Comment 1", O="Hans Grasshopper")
pshare = PSHARE(B=Toggle(False), N=pcollect, I=panel, L=panel_2, U="Hans Grasshopper")
pparam = PPARAM()
