# Dynamo graph watch image.dyn (Dynamo 0.7.5.3566)

file_path = Filename("D:\Temp\test.jpg")
code_block = CodeBlock { "D:/Temp/test.jpg"; }
fromPath = FileObject(code_block)  # "File.FromPath"
readFromFile = Image.ReadFromFile(fromPath)
watch_image = WatchImageCore(readFromFile)
