# Dynamo graph test pCOLLECT3.dyn (Dynamo 1.0.0.1180)

code_block = CodeBlock { "Hans"; }
code_block_2 = CodeBlock { "Param1"; }
code_block_3 = CodeBlock { 10; }
code_block_4 = CodeBlock { "++"; }
code_block_5 = CodeBlock { "This is a test parameter"; }
pCOLLECT = pCOLLECT(code_block_2, code_block_3, code_block_4, code_block_5)
watch = Watch(pCOLLECT)
