# Dynamo graph test pCOLLECT.dyn (Dynamo 0.8.1.1823)

code_block = CodeBlock { "Param2"; }
code_block_2 = CodeBlock { 30; }
code_block_3 = CodeBlock { "I2"; }
code_block_4 = CodeBlock { "C2"; }
code_block_5 = CodeBlock { "O2"; }
pCOLLECT = pCOLLECT(code_block, code_block_2, code_block_3, code_block_4, code_block_5)
watch = Watch(pCOLLECT)
origin = Point.Origin()
code_block_6 = CodeBlock { 0; }
code_block_7 = CodeBlock { 3; }
substring = String.Substring(str=code_block, startIndex=code_block_6, length=code_block_7)
code_block_8 = CodeBlock { "Param3"; }
code_block_9 = CodeBlock { 20; }
code_block_10 = CodeBlock { "I1"; }
code_block_11 = CodeBlock { "C1"; }
code_block_12 = CodeBlock { "O1"; }
pCOLLECT_2 = pCOLLECT(code_block_8, code_block_9, code_block_10, code_block_11, code_block_12)
create = List.Create(pCOLLECT_2, pCOLLECT)
file_path = Filename("D:\Temp\icestadium.csv")
file_path_2 = Filename("D:\Temp\LocalHans.csv")
pSHARE = pSHARE(create, file_path, file_path_2, code_block_12)
watch_2 = Watch(pSHARE)
watch_3 = Watch(create)
code_block_13 = CodeBlock { "Path1"; }
code_block_14 = CodeBlock { "Path2"; }
pPARAM = pPARAM(code_block, pSHARE)
watch_4 = Watch(pPARAM)
origin_2 = Point.Origin()
code_block_15 = CodeBlock { 0; }
toNumber = String.ToNumber(pPARAM)
byCoordinates = Point.ByCoordinates(x=code_block_15, y=toNumber)
