# Dynamo graph test pCOLLECTall3.dyn (Dynamo 0.8.1.1823)

code_block = CodeBlock { "Parameter1"; }
code_block_2 = CodeBlock { 1; }
code_block_3 = CodeBlock { "belangrijk1"; }
code_block_4 = CodeBlock { "commentaar1"; }
pCOLLECT = pCOLLECT(code_block, code_block_2, code_block_3, code_block_4)
code_block_5 = CodeBlock { "Parameter2"; }
code_block_6 = CodeBlock { 2; }
code_block_7 = CodeBlock { "belangrijk2"; }
code_block_8 = CodeBlock { "commentaar2"; }
pCOLLECT_2 = pCOLLECT(code_block_5, code_block_6, code_block_7, code_block_8)
code_block_9 = CodeBlock { "Parameter3"; }
code_block_10 = CodeBlock { 3; }
code_block_11 = CodeBlock { "belangrijk3"; }
code_block_12 = CodeBlock { "commentaar3"; }
code_block_13 = CodeBlock { "extra3"; }
pCOLLECT_3 = pCOLLECT(code_block_9, code_block_10, code_block_11, code_block_12, code_block_13)
create = List.Create(pCOLLECT, pCOLLECT_2, pCOLLECT_3)
watch = Watch(create)
code_block_14 = CodeBlock { "ExtParam1"; }
file_path = Filename("D:\Temp\test2.csv")
file_path_2 = Filename("D:\Temp\test2 - Copy.csv")
code_block_15 = CodeBlock { "eigenaar"; }
pSHARE = pSHARE(create, file_path, file_path_2, code_block_15, lacing=CrossProduct)
pPARAM = pPARAM(code_block_14, pSHARE)
watch_2 = Watch(pPARAM)
watch_3 = Watch(pSHARE)
