# Dynamo graph test pCOLLECTonly.dyn (Dynamo 0.8.1.1823)

code_block = CodeBlock { "extra1"; }
code_block_2 = CodeBlock { "ParameterName"; }
code_block_3 = CodeBlock { 2; }
code_block_4 = CodeBlock { "belangrijk"; }
code_block_5 = CodeBlock { "commentaar"; }
code_block_6 = CodeBlock { "eigenaar"; }
pCOLLECT = pCOLLECT(code_block_2, code_block_3, code_block_4, code_block_5, code_block_6)
watch = Watch(pCOLLECT)
code_block_7 = CodeBlock { MyDataCollector.MyDataCollectorClass.pCOLLECToutputs(); }
watch_2 = Watch(code_block_7)
