# Dynamo graph building pCOLLECT.dyn (Dynamo 0.7.5.3566)

string = StringInput("Parameter1")
code_block = CodeBlock { 215; }
string_2 = StringInput("OldValue1")
custom_pcollect = Custom[pCOLLECT](string0=string, string2=code_block, string4=string_2)
string_3 = StringInput("Parameter2")
string_4 = StringInput(";")
string_5 = StringInput("Value2")
string_6 = StringInput("OldValue2")
concat = String.Concat(string_3, string_4, string_5, string_4, string_6)
create = List.Create(custom_pcollect, concat)
watch = Watch(create)
string_7 = StringInput("Value1")
